# Grasshopper definition redumeMesh.gh (Grasshopper 0.9.76)
# plug-ins: Python Interpreter

panel = Panel("http://www.grasshopper3d.com/forum/topics/how-do-i-reduce-mesh-via-python")

# ---- group: target mesh
mesh = Mesh(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)

# ----
toggle = BooleanToggle(False)
medges = MeshEdges(Mesh=mesh)  # -> NakedEdges, InteriorEdges, NonManifoldEdges
panel_2 = Panel(mesh)
python = PythonScript(M=mesh, P=Slider(99.5, range=0..100), bool=toggle)  # -> out, a, b; inputs M: Mesh
# ---------- python: Python ----------
import Rhino.RhinoApp as ra
import Rhino.RhinoDoc as rd

doc = rd.ActiveDoc;

if bool == True:
    print "Success !!"
    print "reduced by " + str(P) + " percent"
    
    if M is not None:
        meshObj = doc.Objects.AddMesh(M)
        doc.Objects.UnselectAll()
        doc.Objects.Select(meshObj)
        ra.RunScript("_-ReduceMesh _ReductionPercentage %s _Enter" %P ,False)
        mObj = doc.Objects.GetSelectedObjects(False,False)
        geomOut = []
        for m in mObj:
            geomOut.Add(m.Geometry)
        doc.Objects.Delete(meshObj,True)
        a = geomOut

else:
    print "NA"
    
    a = M
# ---------- end python ----------

python_2 = PythonScript(bool=toggle)  # -> out, a; inputs bool: Boolean
# ---------- python_2: Python ----------
# python syntax test

if bool == True:
    print "True, O"

else:
    print "False, X"
# ---------- end python_2 ----------
panel_3 = Panel(python_2.out)

mesh_2 = Mesh(python.a)
panel_4 = Panel(python.out)
panel_5 = Panel(mesh_2)
medges_2 = MeshEdges(Mesh=mesh_2)  # -> NakedEdges, InteriorEdges, NonManifoldEdges
